# Dynamo graph Language_version_v1.3.4.dyn (Dynamo 1.3.4.6666)

python_script = Python()  # unwired: IN[0]
# ---------- python_script.python (12 lines) ----------
import clr
clr.AddReference('RevitServices')
import RevitServices
from RevitServices.Persistence import DocumentManager
#The inputs to this node will be stored as a list in the IN variables.

doc = DocumentManager.Instance.CurrentDBDocument
uiapp = DocumentManager.Instance.CurrentUIApplication
app = uiapp.Application


OUT = app.Language
# ----------------------------------------
