# Dynamo graph GetCurrentDynamoFilePath.dyn (Dynamo 1.0.1.1503)

# group: Dimitar Venkov Script to Read The Last Log File Of The Current Script
code_block = CodeBlock()
# ---------- code_block.designscript (7 lines) ----------
//dir to Dynamo's log files

//the file is only backed up
//some time after opening it
//it would have been great if
//each graph open event is
//logged in instead
# ----------------------------------------
directory_path = Directory("C:\Users\buenh\AppData\Roaming\Dynamo\Dynamo Revit\1.0\Logs")
boolean = BoolSelector(false)
python_script_by_dimitar_venkov = Python(IN[0]=directory_path, IN[1]=boolean)
# ---------- python_script_by_dimitar_venkov.python (18 lines) ----------
import clr
import sys
sys.path.append('C:\\Program Files (x86)\\IronPython 2.7\\Lib')
import glob, os

log_path = IN[0]
file_path = None
error = 'No Record Found.'

latest = max(glob.iglob('%s\\*.txt'%log_path), key=os.path.getctime)
with open(latest, 'rb') as f:
	for line in reversed(list(f) ):
		if 'Saving' in line:
				file_path = line.rsplit(" ",2)[1].strip()
				break
				
OUT = (file_path, os.path.split(file_path)[1])\
if file_path != None else error
# ----------------------------------------
watch = Watch(python_script_by_dimitar_venkov)
code_block_2 = CodeBlock()
# ---------- code_block_2.designscript (6 lines) ----------
//the node fetches the latest log file
//and extracts the latest save path

//if you save your graph after
//execution, a save trigger will
//be iniciated that will be logged
# ----------------------------------------

# group: Andreas Dieckmann - Python Script To Obtain Current Dynamo File Path
boolean_2 = BoolSelector(false)
python_script_by_andreas = Python(IN[0]=boolean_2)  # "Python Script by Andreas Dieckmann"
# ---------- python_script_by_andreas.python (34 lines) ----------
import clr
import sys
sys.path.append('C:\\Program Files (x86)\\IronPython 2.7\\Lib')
import glob
import os
#
# Save, reset and run the script
reset = IN[0]
#
# Path to the storage location of the Dynamo file version
log_path = os.path.expanduser(
	"~\\AppData\\Roaming\\Dynamo\\DynamoCore\\1.0\\Logs")
file_path = None
error = 'No Record Found.'
# OUT = glob.glob(log_path)
# In% s - the path log_path is substituted, and inside the function iglob is triggered
# sort all files insede the log_path folder
file_pattern = '%s\\*.txt' % log_path
all_log_files = glob.iglob(file_pattern)  # All files in the lo_path folder

# File with the latest date
latest_file = max((all_log_files), key=os.path.getctime)

list_of_lines = []
with open(latest_file, 'rb') as f: # Open the last log file with the rb flag
	for line in reversed(list(f)): # Read from the end of line this file
	
		if 'Saving' in line: # find the path to the folder in the line User\AppData
			if os.path.expanduser("~\\AppData") in line:
				pass
			else: # Define the storage folder for the current dyn file
				file_path = line.rsplit(" ",2)[1].strip()
				break
OUT = file_path if life_path != None else error
# ----------------------------------------
watch_2 = Watch(python_script_by_andreas)

code_block_3 = CodeBlock()  # same code as code_block
directory_path_2 = Directory("C:\Users\buenh\AppData\Roaming\Dynamo\Dynamo Revit\1.0\Logs")
boolean_3 = BoolSelector(false)
python_script_by_dimitar_venkov_2 = Python(IN[0]=directory_path_2, IN[1]=boolean_3)  # "Python Script by Dimitar Venkov modified by Haley Bueno"
# ---------- python_script_by_dimitar_venkov_2.python (22 lines) ----------
import clr
import sys
sys.path.append('C:\\Program Files (x86)\\IronPython 2.7\\Lib')
import glob, os

log_path = IN[0]
file_path = None
error = 'No Record Found.'

latest = max(glob.iglob('%s\\*.txt'%log_path), key=os.path.getctime)
with open(latest, 'rb') as f:
	for line in reversed(list(f) ):
	
		if 'Saving' in line:
			if os.path.expanduser("~\\AppData") in line:
				pass
			else:
				file_path = line.rsplit(" ",2)[1].strip()
				break
				
OUT = (file_path, os.path.split(file_path)[1])\
if file_path != None else error
# ----------------------------------------
watch_3 = Watch(python_script_by_dimitar_venkov_2)
code_block_4 = CodeBlock()  # same code as code_block_2
