# Dynamo graph Navisworks_True_BatchUtility.dyn (Dynamo 1.3.4.6666)

# group: Парсер ревитсервера
адрес_ревит_сервера = CodeBlock { "revit1.bim"; }
папка_на_сервере = CodeBlock { "Папка проекта/АР"; }
forceChildrensEval = ForceChildrensEval()  # unwired: arg0
парсер_ревитсервера = Python(IN[0]=адрес_ревит_сервера, IN[1]=папка_на_сервере, IN[2]=forceChildrensEval)  # frozen
# ---------- парсер_ревитсервера.python (84 lines) ----------
# -*- coding: utf-8 -*- 
#-----------------------Импоорт библиотек----------------------
import clr
import sys 
sys.path.append("C:\Program Files (x86)\IronPython 2.7\Lib")
import os

import System
from System import Guid
from System import DateTime
from System.IO import StreamReader
from System.Net import WebRequest
clr.AddReference('System.Web.Extensions')
from System.Web.Script.Serialization import JavaScriptSerializer 

clr.AddReference('RevitAPI')
import Autodesk
from Autodesk.Revit.DB import ModelPathUtils


clr.AddReference("RevitServices")
import RevitServices
from RevitServices.Persistence import DocumentManager

#-----------------------ФУНКЦИИ----------------------

def rsnrequest(p_f_n):
	request = WebRequest.Create("http://"+revit_server_name+"/RevitServerAdminRESTService"+version+"/AdminRESTService.svc/|"+p_f_n+"|/contents")		
	request.Method = "GET"
	request.Headers.Add("User-Name", os.environ.get('USERNAME'))
	request.Headers.Add("User-Machine-Name", os.getenv('COMPUTERNAME', 'defaultValue'))
	request.Headers.Add("Operation-GUID", Guid.NewGuid().ToString())

	rsp = request.GetResponse()
	stream_reader = StreamReader(rsp.GetResponseStream())

	jsonData = stream_reader.ReadToEnd()

	json = JavaScriptSerializer().DeserializeObject(jsonData)
	return (json)

def folderpars(folderslist):
	for fldr in folderslist:
		path = "rsn://"+revit_server_name+"/"+project_folder_name+"/"+fldr+"/"
		json = rsnrequest(project_folder_name+"|"+fldr)	
		model_data_list = json["Models"]
		models_list = [m["Name"] for m in model_data_list]
		for model in models_list:
			#mpatch = ModelPathUtils.ConvertUserVisiblePathToModelPath(path+model)
			paths.append(path+model)
	return paths	

#-----------------------АПИ ПАРАМЕТРЫ----------------------

app = DocumentManager.Instance.CurrentUIApplication.Application
version = app.VersionNumber

#-----------------------РАБОЧИЕ ПАРАМЕТРЫ----------------------

revit_server_name = IN[0] #Server name: "sh35revit1.hals.local"
folder_path = IN[1] #Project folder name: "Павлова 38"

paths = []

out = None

#-----------------------НАЧАЛО СКРИПТА----------------------
if "/" in folder_path:
	corect_folder = folder_path.replace("/", "|")	
else:
	corect_folder = folder_path


#path = "rsn://"+revit_server_name+"/"+project_folder_name
if "|" in corect_folder:
	project_folder_name = corect_folder.split("|")[0]
	out = folderpars([corect_folder.split("|")[1]])
else:
	json = rsnrequest(corect_folder)
	folder_data_list = json["Folders"]
	find_folders_list = [m["Name"] for m in folder_data_list]
	out = folderpars(find_folders_list)

OUT = out
# ----------------------------------------
code_block = CodeBlock { "Папка проекта"; }
если_надо_выбрать_один_файл_из = CodeBlock { {x[5]}; }  # "Если надо выбрать один файл из папки, запустить, найти имя в "Парсер ревитсервера" указать полученый индекс:"; unwired: x

выполнить = BoolSelector(true)

# group: Парсер локальной папки
directory_path = Directory("C:\test")
forceChildrensEval_2 = ForceChildrensEval(directory_path)
парсер_локальной_папки = Python(IN[0]=forceChildrensEval_2)
# ---------- парсер_локальной_папки.python (11 lines) ----------
import sys
sys.path.append('C:\Program Files (x86)\IronPython 2.7\Lib')
import os
import glob

dir = IN[0]

names = os.listdir(dir)
names2 = glob.glob(dir+"\\*.rvt")

OUT = names2
# ----------------------------------------

directory_path_to_nwc_export = Directory("C:\test")
создание_nwc = Python(IN[0]=выполнить, IN[1]=парсер_локальной_папки, IN[2]=directory_path_to_nwc_export)
# ---------- создание_nwc.python (77 lines) ----------
# -*- coding: utf-8 -*-
if IN[0]:
	import clr
	clr.AddReference('RevitServices')
	import RevitServices
	from RevitServices.Persistence import DocumentManager
	#from RevitServices.Transactions import TransactionManager

	clr.AddReference('RevitAPI')
	import Autodesk.Revit.DB
	from Autodesk.Revit.DB import NavisworksExportScope, View3D, FilteredElementCollector, Document, ModelPathUtils, OpenOptions, NavisworksExportOptions, NavisworksCoordinates, DetachFromCentralOption

	import System
	from System import TimeSpan

	class TimeCounter:
		def __init__(self):
			self.time = System.Diagnostics.Stopwatch.StartNew()
			self.time.Start()
		def stop(self):
			self.time.Stop()
			return self.time.Elapsed

	uiapp = DocumentManager.Instance.CurrentUIApplication
	app = uiapp.Application
	doc = DocumentManager.Instance.CurrentDBDocument

	file_list = IN[1]
	foldere_to_export = IN[2]
	opt = OpenOptions()
	opt.DetachFromCentralOption = DetachFromCentralOption.DetachAndPreserveWorksets
	opt.AllowOpeningLocalByWrongUser = True
	#views3d = [v for v in FilteredElementCollector(doc).OfClass(View3D) if not v.IsTemplate]
	#view_3d_navisworks = [view for view in views3d if "navisworks" in view.Name]

	def re_file(file_str): # type: str
		mpath = ModelPathUtils.ConvertUserVisiblePathToModelPath(file_str)
		doc = app.OpenDocumentFile(mpath,opt)
		nw_ex_opt = NavisworksExportOptions()
		
		views3d = [v for v in FilteredElementCollector(doc).OfClass(View3D) if not v.IsTemplate]
		view_3d_navisworks = [view for view in views3d if "navisworks" in view.Name.lower()]
		if view_3d_navisworks:
			nw_ex_opt.ExportScope = NavisworksExportScope.View
			nw_ex_opt.ViewId = view_3d_navisworks[0].Id
		nw_ex_opt.ExportRoomGeometry = False
		nw_ex_opt.Coordinates = NavisworksCoordinates.Shared
		nw_ex_opt.ExportLinks = False
		nw_ex_opt.ExportParts = True
		doc.Export(foldere_to_export, doc.Title, nw_ex_opt)
		doc.Close(False)
		#return view_3d_navisworks

	test = []
	all_time_dic = {}

	for file_str in file_list:
		time = TimeCounter()
		test.append(re_file(file_str)) # важна только эта строчка
		t = time.stop()
		all_time_dic[file_str] = t

	all_time_by_file = []
	all_time_by_file.append("File time")
	for file, time in all_time_dic.items():
		if 'full_time_count' not in locals():
			full_time_count = time
			all_time_by_file.append((file, (time.Minutes, time.Seconds, time.Milliseconds)))
		else:
			full_time_count += time
			all_time_by_file.append((file, (time.Minutes, time.Seconds, time.Milliseconds)))

	full_time = (("Minutes", "Seconds", "Milliseconds"), "Full time:", (full_time_count.Minutes, full_time_count.Seconds, full_time_count.Milliseconds))

	OUT = full_time, all_time_by_file
else:
	OUT = 'not run'
# ----------------------------------------
