# Dynamo graph Wall_Finishing_v1.3.4.dyn (Dynamo 2.9.0.3137)

code_block = CodeBlock()
# ---------- code_block.designscript (2 lines) ----------
"https://api.github.com/repos/romangolev/dynamo-scripts/contents/wall_finishing/Wall_Finishing_v1.3.4.py?ref=master";
"C:\\temp\\dynamo-scripts\\Wall_Finishing_v1.3.4.py";
# ----------------------------------------
python_script = Python(IN[0]=code_block.out1, IN[1]=code_block.out0)  # IronPython2
# ---------- python_script.python (47 lines) ----------
# Handling import
import clr
import sys 
sys.path.append("C:\Program Files (x86)\IronPython 2.7\Lib")
import os
import System
from System import Guid
from System import DateTime
from System.IO import StreamReader
from System.Net import WebRequest, HttpRequestHeader
clr.AddReference('System.Web.Extensions')
from System.Web.Script.Serialization import JavaScriptSerializer 
from System import Type, Activator, IO, Text, Uri, Convert


file_path = IN[0]
file_link = IN[1]
#file_link = 'https://api.github.com/repos/romangolev/dynamo-scripts/contents/wall_finishing/Wall_Finishing_v1.3.4.py?ref=master'
#file_path = 'C:\\temp\\dynamo-scripts\\Wall_Finishing_v1.3.4.py'


def LogSaveStrList(string_list):
	IO.File.AppendAllLines(file_path, flatten(string_list), Text.Encoding.Unicode)
def LogSaveStr(string):
	IO.File.WriteAllText(file_path, string, Text.Encoding.Unicode)
def rsnrequest():
	request = WebRequest.Create(file_link)
	request.Method = "GET"
	request.UserAgent = "Anything"
	#token = ''
	#request.Headers["OAUTH-TOKEN"] = token
	rsp = request.GetResponse()
	stream_reader = StreamReader(rsp.GetResponseStream())
	jsonData = stream_reader.ReadToEnd()
	stream_reader.Close()
	json = JavaScriptSerializer().DeserializeObject(jsonData)
	return json


json_recv = rsnrequest()
data_from_json = json_recv["content"]
base64EncodedBytes = System.Convert.FromBase64String(data_from_json)
python_code_string = System.Text.Encoding.UTF8.GetString(base64EncodedBytes)
LogSaveStr(python_code_string)


OUT = python_code_string
# ----------------------------------------
string = StringInput("C:\temp\rpw.zip")  # graph input
python_script_from_string = PythonStringNode(script=python_script, IN[0]=string)  # IronPython2
