# Dynamo graph excel_export.dyn (Dynamo 2.9.0.3137)

string = StringInput("C:\\users\\DELL\\Desktop\\test.py")
read_python_script_from_file = Python(IN[0]=string)  # IronPython2
# ---------- read_python_script_from_file.python (23 lines) ----------
import clr
import sys 
sys.path.append("C:\Program Files (x86)\IronPython 2.7\Lib")
import os
import System
from System import Guid
from System import DateTime
from System.IO import StreamReader
from System.Net import WebRequest, HttpRequestHeader
clr.AddReference('System.Web.Extensions')
from System.Web.Script.Serialization import JavaScriptSerializer 
from System import Type, Activator, IO, Text, Uri, Convert


file_path = IN[0]

all_data = ""
with open (file_path, "r") as myfile:
    data=myfile.readlines()
    for i in data:
   		all_data += i

OUT = all_data
# ----------------------------------------
string_2 = StringInput("\"132\"")
python_script_from_string = PythonStringNode(script=read_python_script_from_file, IN[0]=string_2)  # IronPython2
