# Dynamo graph exportNWD.dyn (Dynamo 1.3.4.6666)

file_path = Filename("C:\Users\kkozlov\test1.rvt")
code_block = CodeBlock()
# ---------- code_block.designscript (8 lines) ----------
"RSN://192.168.10.28/1030_riversky/01_architecture/rvsk_k6_rd_ar.rvt";
"RSN://192.168.10.28/1030_riversky/01_architecture/rvsk_k7_rd_ar.rvt";
"RSN://192.168.10.28/1030_riversky/01_architecture/rvsk_k8_rd_ar.rvt";
"RSN://192.168.10.28/1030_riversky/01_architecture/rvsk_park3_rd_ar.rvt";
"RSN://192.168.10.28/1030_riversky/01_architecture/rvsk_k6_rd_kr.rvt";
"RSN://192.168.10.28/1030_riversky/01_architecture/rvsk_k7_rd_kr.rvt";
"RSN://192.168.10.28/1030_riversky/01_architecture/rvsk_k8_rd_kr.rvt";
"RSN://192.168.10.28/1030_riversky/01_architecture/rvsk_park3_rd_kr.rvt";
# ----------------------------------------
create = List.Create(file_path, code_block.out0)
directory_path = Directory("C:\Users\rgolev\Desktop")
code_block_2 = CodeBlock { "navisworks"; }
rvtToNwc = Custom[rvtToNwc](ModelPaths=create, OutputDirectory=directory_path, ViewName=code_block_2)  # Export Revit models into Navisworks
